# Grasshopper definition intro.gh (Grasshopper 1.0.7)

python = GhPythonScript()  # -> out, file
# ---------- python: Python ----------
import rhinoscriptsyntax as rs

filter = "GCode (*.gcode)|*.gcode|All Files (*.*)|*.*||"
file = rs.SaveFileName("", filter)
# ---------- end python ----------
panel = Panel(python.out)
python_2 = GhPythonScript(file=python.file, sides=Slider(10, range=0..20), size=Slider(12, range=0..50), layers=Slider(2, range=0..500))  # -> out, lines, turtle, draw_bed; inputs sides: Int32, layers: Int32
# ---------- python_2: Python ----------
import rhinoscriptsyntax as rs
import random as r
import extruder_turtle
from extruder_turtle import *
import math

t = ExtruderTurtle()
forward = 1
t.setup(filename = file, printer = "ender")
extrude_rate = t.get_extrude_rate()
layer_height = t.get_layer_height()



turtle = t.draw_turtle()
lines = t.get_lines()
t.finish()
# ---------- end python_2 ----------
